# Grasshopper definition material-mapper.gh (Grasshopper 1.0.7)

number_slider = Slider(20, range=0..10000)
dx = Slider(0.01, range=0..1)
pipeline = GeometryPipeline(
    GroupByLayer=False,
    GroupByType=False,
    IncludeHidden=True,
    IncludeLocked=True,
    LayerFilter="Layer 01",
    NameFilter="*",
    SublayerFiltering=True,
    TypeFilter=1073741852)
pipeline_2 = GeometryPipeline(
    GroupByLayer=False,
    GroupByType=False,
    IncludeHidden=True,
    IncludeLocked=True,
    LayerFilter="Layer 02",
    NameFilter="*",
    SublayerFiltering=True,
    TypeFilter=1073741852)
pipeline_3 = GeometryPipeline(
    GroupByLayer=False,
    GroupByType=False,
    IncludeHidden=True,
    IncludeLocked=True,
    LayerFilter="Layer 03",
    NameFilter="*",
    SublayerFiltering=True,
    TypeFilter=1073741852)
pipeline_4 = GeometryPipeline(
    GroupByLayer=False,
    GroupByType=False,
    IncludeHidden=True,
    IncludeLocked=True,
    LayerFilter="Layer 04",
    NameFilter="*",
    SublayerFiltering=True,
    TypeFilter=1073741852)
pipeline_5 = GeometryPipeline(
    GroupByLayer=False,
    GroupByType=False,
    IncludeHidden=True,
    IncludeLocked=True,
    LayerFilter="Layer 05",
    NameFilter="*",
    SublayerFiltering=True,
    TypeFilter=1073741852)
geo = Geometry([pipeline, pipeline_2, pipeline_3, pipeline_4, pipeline_5])
cluster = Cluster(x_count_pts=number_slider, all_geometry=geo, y_count_pts=number_slider, dx=dx)
test_tolerance = Slider(0.004, range=0..0.1)
flip = FlipMatrix(Data=cluster)
cluster_2 = Cluster_2(discrete_points=cluster, geometry=pipeline, tolerance=test_tolerance, material_id="1")  # -> material_flag, srfs, crvs
cluster_3 = Cluster_2(discrete_points=cluster, geometry=pipeline_2, tolerance=test_tolerance, material_id="2")  # -> material_flag, srfs, crvs
cluster_4 = Cluster_2(discrete_points=cluster, geometry=pipeline_3, tolerance=test_tolerance, material_id="3")  # -> material_flag, srfs, crvs
cluster_5 = Cluster_2(discrete_points=cluster, geometry=pipeline_4, tolerance=test_tolerance, material_id="4")  # -> material_flag, srfs, crvs
cluster_6 = Cluster_2(discrete_points=cluster, geometry=pipeline_5, tolerance=test_tolerance, material_id="5")  # -> material_flag, srfs, crvs
item = ListItem(List=cluster, Index=0, Wrap=True)
material_flag = Number(cluster_3.material_flag)
material_flag_2 = Number(cluster_5.material_flag)
material_flag_3 = Number(cluster_6.material_flag)
material_flag_4 = Number(cluster_2.material_flag)
material_flag_5 = Number(cluster_4.material_flag)
merge = Merge(
    Data1=graft(material_flag_4),
    Data2=graft(material_flag),
    Data3=graft(material_flag_5),
    Data4=graft(material_flag_2),
    Data5=graft(material_flag_3))
cluster_7 = Cluster_4(k=Slider(3, range=0..10), rho=Slider(100, range=0..2000), c_p=Slider(100, range=0..2000), idx="0")
cluster_8 = Cluster_4(k=Slider(6, range=0..10), rho=Slider(100, range=0..2000), c_p=Slider(100, range=0..2000), idx="1")
cluster_9 = Cluster_4(k=Slider(2.3, range=0..10), rho=Slider(1000, range=0..2000), c_p=Slider(1000, range=0..2000), idx="2")
cluster_10 = Cluster_4(k=Slider(1, range=0..10), rho=Slider(200, range=0..2000), c_p=Slider(200, range=0..2000), idx="4")
cluster_11 = Cluster_4(k=Slider(0.039, range=0..10), rho=Slider(1450, range=0..2000), c_p=Slider(35, range=0..2000), idx="3")
cluster_12 = Cluster_3(merged_flags=merge)
tag = TextTag(Location=simplify(cluster), Text=cluster_12)  # disabled
python = GhPythonScript(defs=[cluster_7, cluster_8, cluster_9, cluster_11, cluster_10])  # -> out, definitions_table; inputs defs: list
# ---------- python: Python ----------
__author__ = "Sam Wolk"
__version__ = "2023.05.03"

import rhinoscriptsyntax as rs
import json

def_list = [json.loads(defn) for defn in defs]

def_list.sort(key=lambda defn: defn["idx"])

definitions_table = json.dumps(def_list)

print(definitions_table)
# ---------- end python ----------
python_2 = GhPythonScript(material_map=cluster_12, definitions_table=python.definitions_table, run=Button())  # -> out, a; inputs material_map: tree of Int32, run: Boolean
# ---------- python_2: Python ----------
__author__ = "Sam Wolk"
__version__ = "2023.05.03"

import rhinoscriptsyntax as rs
import urllib2
import json
import ghpythonlib.treehelpers as th


if run:
    map = []
    for i in range(material_map.BranchCount):
        row = [int(val) for val in material_map.Branch(i)]
        map.append(row)
    
    data = {
        "defs": json.loads(definitions_table),
        "map": map,
    }
    request = urllib2.Request("http://localhost:5000")
    request.add_data(json.dumps(data))
    request.add_header("Content-type", "application/json")
    request.add_header("Accept", "application/json")
    #
    res = urllib2.urlopen(request)
    res = json.load(res)
    print(res)
# ---------- end python_2 ----------

# ==== cluster Cluster
all_geometry = ClusterInput()
bbox = BoundingBox(AllGeometry=all_geometry, Plane=PlaneXY(0, 0, 0), UnionBox=True)  # -> Box, Box_2
dx = ClusterInput()
debox = DeconstructBox(Box=bbox.Box)  # -> Plane, X, Y, Z
dedomain = DeconstructDomain(Domain=debox.X)  # -> Start, End
dedomain_2 = DeconstructDomain(Domain=debox.Y)  # -> Start, End
expression = Expression(start=dedomain.Start, end=dedomain.End, dx=dx, Expression="floor((end-start)/dx)")
x_count_pts = ClusterInput()  # disabled
expression_2 = Expression(start=dedomain_2.Start, end=dedomain_2.End, dx=dx, Expression="floor((end-start)/dx)")
y_count_pts = ClusterInput()  # disabled
subtraction = Subtraction(XCountPts=x_count_pts, B=1)  # disabled
subtraction_2 = Subtraction(YCountPts=y_count_pts, B=1)  # disabled
planesrf = PlaneSurface(Plane=debox.Plane, XSize=debox.X, YSize=debox.Y)  # disabled
series = Series(Start=0, Step=dx, Count=expr("x+1", expression_2))
series_2 = Series(Start=0, Step=dx, Count=expr("x+1", expression))
sdivide = DivideSurface(Surface=planesrf, UCount=expression, VCount=expression_2)  # -> DiscretePoints, Normals, Parameters; disabled
addition = Addition(A=dedomain.Start, B=series_2)
addition_2 = Addition(A=dedomain_2.Start, B=series)
number_slider = Slider(10, range=0..10)  # disabled
crossref = CrossReference(ListA=addition_2, ListB=addition, CrossMode=1)  # -> ListA, ListB
pt = ConstructPoint(XCoordinate=crossref.ListB, YCoordinate=crossref.ListA, ZCoordinate=0)
item = ListItem(List=sdivide.DiscretePoints, Index=number_slider, Wrap=True)  # disabled
partition = PartitionList(List=pt, Size=expr("x+1", expression))
item_2 = ListItem(List=sdivide.DiscretePoints, Index=number_slider, Wrap=True)  # disabled
C = ClusterOutput(partition)

# ==== cluster Cluster_2
geometry = ClusterInput()
tolerance = ClusterInput()
discrete_points = ClusterInput()
material_id = ClusterInput()
geometry_2 = Surface(geometry)
srf_cp = SurfaceClosestPoint(DiscretePoints=graft(discrete_points), Surface=geometry_2)  # -> Point, UVPoint, Distance
smaller = SmallerThan(FirstNumber=srf_cp.Distance, SecondNumber=tolerance)  # -> SmallerThan, OrEqualTo
ma = MassAddition(Input=smaller.OrEqualTo)  # -> simplify(Result), PartialResults
trim = TrimTree(Tree=ma.Result, Depth=1)
min = Minimum(A=trim, B="1")
multiplication = Multiplication(A=min, MaterialID=material_id)
material_flag = ClusterOutput(multiplication)
srfs = ClusterOutput(geometry_2)
crvs = ClusterOutput(geometry)

# ==== cluster Cluster_3
merged_flags = ClusterInput()
sort = SortList(MergedFlags=merged_flags)  # -> Keys, ValuesA
rev = ReverseList(List=sort.Keys)
item = ListItem(List=rev, Index=0, Wrap=True)
trim = TrimTree(Tree=item, Depth=1)
subtraction = Subtraction(A=trim, B=1)
R = ClusterOutput(subtraction)

# ==== cluster Cluster_4
idx = ClusterInput()
k = ClusterInput()
rho = ClusterInput()
c_p = ClusterInput()
python = GhPythonScript(k=k, rho=rho, c_p=c_p, idx=idx)  # -> out, Material_Definition; inputs idx: Int32
# ---------- python: Python ----------
__author__ = "Sam Wolk"
__version__ = "2023.05.03"

import rhinoscriptsyntax as rs
import json
Material_Definition =  json.dumps({
    "k": k,
    "rho": rho,
    "c_p": c_p,
    "idx": idx
})
# ---------- end python ----------
material_definition = ClusterOutput(python.Material_Definition)
