# Grasshopper definition t-beam-generator.gh (Grasshopper 1.0.7)

b1 = Slider(3.361, range=1..4)
h1 = Slider(0.959, range=0.1..4)
b2 = Slider(0.581, range=0.1..4)
h2 = Slider(4, range=1..4)

# ---- group: Base Point (Top Corner)
pt = ConstructPoint(XCoordinate=0, YCoordinate=0, ZCoordinate=0)
yz = YZPlane(Origin=pt)

# ---- group: Top Rectangle
division = Division(A=b1, B="2")
neg = Negative(Value=h1)
rectangle = Rectangle(Plane=yz, XSize=b1, YSize=neg, Radius=0)  # -> Rectangle, Length
geo = Geometry(rectangle.Rectangle)

# ----
vert = Expression(h_1=h1, h_2=h2, Expression="h_1 + h_2/2")
expression = Expression(b=[b1, b2], h=[h1, h2], Expression="b*h*h*h/12")
expression_2 = Expression(b=[b1, b2], h=[h1, h2], Expression="b*h*h*h/12")
expression_3 = Expression(h_1=h1, Expression="h_1/2")
expression_4 = Expression(b=[b1, b2], h=[h1, h2], Expression="b*h")
b_1_2 = Expression(b_1=b1, Expression="b_1/2")
merge = Merge(Data1=expression_3, Data2=vert)
expression_5 = Expression(areas=expression_4, vert_coms=merge, Expression="areas*vert_coms")
ma = MassAddition(Weighted_areas=expression_5)  # -> Com_numerator, PartialResults
ma_2 = MassAddition(Input=expression_4)  # -> Total_area, PartialResults
expression_6 = Expression(total_area=ma_2.Total_area, com_num=ma.Com_numerator, Expression="com_num / total_area")
expression_7 = Expression(vert_com=expression_6, vert_coms=merge, Expression="vert_coms - vert_com")
I = Expression(I=expression, a=expression_4, d=expression_7, Expression="I+a*d*d")
ma_3 = MassAddition(Input=I)  # -> Result, PartialResults
panel = Panel(ma_3.Result)

# ---- group: Bottom Rectangle
division_2 = Division(A=b2, B="2")
neg_2 = Negative(Value=division_2)
dom = ConstructDomain(DomainStart=neg_2, DomainEnd=division_2)
neg_3 = Negative(Value=h2)
pt_2 = ConstructPoint(XCoordinate=0, YCoordinate=division, ZCoordinate=neg)
yz_2 = YZPlane(Origin=pt_2)
rectangle_2 = Rectangle(Plane=yz_2, XSize=dom, YSize=neg_3, Radius=0)  # -> Rectangle, Length

# ---- group: COM: Geo Derived
area = Area(Geometry=[rectangle.Rectangle, rectangle_2.Rectangle])  # -> Area, Centroid
pdecon = Deconstruct(Point=area.Centroid)  # -> XComponent, YComponent, ZComponent
multiplication = Multiplication(A=area.Area, B=pdecon.ZComponent)
ma_4 = MassAddition(Input=area.Area)  # -> Result, PartialResults
ma_5 = MassAddition(Input=multiplication)  # -> Result, PartialResults
division_3 = Division(A=ma_5.Result, B=ma_4.Result)
pt_3 = ConstructPoint(XCoordinate=0, YCoordinate=division, ZCoordinate=division_3)
panel_2 = Panel(pt_3)

# ---- group: COM: Explicit
geo_2 = Geometry(rectangle_2.Rectangle)
join = BrepJoin(Breps=[geo_2, geo])  # -> Breps, Closed
fmerge = MergeFaces(Brep=join.Breps)  # -> Breps, Before, After
area_2 = Area(Geometry=fmerge.Breps)  # -> Area, Centroid
panel_3 = Panel(area_2.Centroid)

# ---- group: I: Parallel Axis
amoments = AreaMoments(Geometry=[rectangle.Rectangle, rectangle_2.Rectangle])  # -> Area, Centroid, Inertia, InertiaError, Secondary, SecondaryError, Gyration
pdecon_2 = Deconstruct(Point=amoments.Centroid)  # -> XComponent, YComponent, ZComponent
pdecon_3 = Deconstruct(Point=amoments.Inertia)  # -> XComponent, YComponent, ZComponent
subtraction = Subtraction(A=division_3, B=pdecon_2.ZComponent)
multiplication_2 = Multiplication(A=subtraction, B=subtraction)
multiplication_3 = Multiplication(A=multiplication_2, B=amoments.Area)
addition = Addition(A=multiplication_3, B=pdecon_3.YComponent)
ma_6 = MassAddition(Input=addition)  # -> Result, PartialResults
panel_4 = Panel(ma_6.Result)

# ---- group: I: Explicit
amoments_2 = AreaMoments(Geometry=fmerge.Breps)  # -> Area, Centroid, Inertia, InertiaError, Secondary, SecondaryError, Gyration
pdecon_4 = Deconstruct(Point=amoments_2.Inertia)  # -> XComponent, YComponent, ZComponent
panel_5 = Panel(pdecon_4.YComponent)
